test file "uav_altitude_hold_harness_tests"

suite "Harness Tests"

  case "Harness1 - Nominal Tracking" [baseline]
    description: Closed-loop response to hover, climb, and descend commands (Harness1).
    model uav_altitude_hold, harness uav_altitude_hold_Harness1, stop time 6
    baseline "baseline_harness1.mat"
      throttle_cmd_out:1

  case "Harness2 - Input Validity Fallback" [baseline]
    description: Sensor-invalid, out-of-range altitude, and out-of-range rate all fall back to 0.5 (Harness2).
    model uav_altitude_hold, harness uav_altitude_hold_Harness2, stop time 10
    baseline "baseline_harness2.mat"
      throttle_cmd_out:1